# Grasshopper definition test.gh (Grasshopper 1.0.7)
# plug-ins: MyGrasshopperPlugIn

test = TestPython(TextToLower="HELLO", TextToUpper="from python")
startpy = StartPythonComponent(
    StartPython=Toggle(True),
    UserMode="false",
    Level=40000,
    TimeOut=10,
    CondaEnvironmentName="myenvironment",
    AnacondaDirectory="C:\Users\Jonas\Anaconda3")
panel = Panel(test)
